# Grasshopper definition GH1.gh (Grasshopper 1.0.7)

number_of_blocks_to_use_for_commercial = Slider(14, range=1..20)
m3_of_commercial_per_house = Slider(80, range=10..100)
height_of_commercial_levels = Slider(3.4, range=2.7..4)

# ---- group: Blocks to use
offset_from_streets_mt = Slider(0, range=-20..0)
block_polylines_geo = Geometry([<curve referenced from the Rhino model> x16])

# ----
building_depth = Slider(-16, range=-25..-10)
houses = Slider(6572, range=5000..12000)

# ---- group: VALUIES INPUT
size_of_the_house_in_m3_int = Integer(300)
_11220_houses_int = Integer(11220)

# ---- group: VOLUME OF RESIDENNCE
multiplication = Multiplication(A=houses, B=size_of_the_house_in_m3_int)

# ---- group: BUILDING FOOTPRINTS AND NUMBERS
offset = OffsetCurve(Curve=block_polylines_geo, Distance=offset_from_streets_mt, Plane=PlaneXY(0, 0, 0), Corners=1)  # -> flatten(Curve)
offset_2 = OffsetCurve(Curve=offset, Distance=building_depth, Plane=PlaneXY(0, 0, 0), Corners=1)  # -> flatten(Curve)
rdiff = RegionDifference(CurvesA=offset, CurvesB=offset_2)

# ---- group: BUILDING FOOTPRINTS AND NUMBERS / Building footprints
boundary = BoundarySurfaces(Edges=rdiff)

# ---- group: EXTRUSION OF COMMERCIAL SPACES
split = SplitList(List=boundary, Index=number_of_blocks_to_use_for_commercial)  # -> ListA, ListB
area = Area(Geometry=split.ListA)  # -> Area, Centroid
multiplication_2 = Multiplication(A=m3_of_commercial_per_house, B=houses)
python = GhPythonScript(vol=multiplication_2, areas=area.Area, levelHeight=height_of_commercial_levels)  # -> out, Nlevels, Nblocks; inputs areas: list
# ---------- python: Python ----------
__author__ = "gabo"
__version__ = "2019.02.01"

import rhinoscriptsyntax as rs

TOTarea = 0
for i in areas:
    TOTarea = TOTarea + i

TOTheight = vol/TOTarea
print TOTheight
Nblocks = 0
cumVol = 0

if TOTheight < levelHeight:
    Nlevels = 1
    for j in areas:
        cumVol = cumVol + (j * (Nlevels*levelHeight))
        if cumVol < vol:
            Nblocks = Nblocks+1
else:
    Nlevels = int(TOTheight/levelHeight)
    for j in areas:
        cumVol = cumVol + (j * (Nlevels*levelHeight))
        if cumVol < vol:
            Nblocks = Nblocks+1
# ---------- end python ----------
split_2 = SplitList(List=boundary, Index=python.Nblocks)  # -> ListA, ListB
multiplication_3 = Multiplication(A=python.Nlevels, B=height_of_commercial_levels)
height_of_commercial_spaces = Panel(multiplication_3)
Z = UnitZ(Factor=multiplication_3)

# ---- group: BUILDING FOOTPRINTS AND NUMBERS (continued)
area_2 = Area(Geometry=boundary)  # -> Area, Centroid
lng = ListLength(List=boundary)
subtraction = Subtraction(A=lng, B=1)
range = Range(Domain=subtraction, Steps=subtraction)  # -> flatten(Range)
tag = TextTag3D(
    Location=area_2.Centroid,
    Text=range,
    Size=Slider(15, range=0..100),
    Colour=ColourSwatch(SwatchColor=RGB(28, 52, 84)),
    Justification=5)

# ---- group: EXTRUSION OF COMMERCIAL SPACES / Commercial extrusion
extr = Extrude(Base=split_2.ListA, Direction=Z)

# ----
preview = CustomPreview(
    Geometry=extr,
    Material={diffuse=RGB(150, 42, 131), emission=RGB(0, 0, 0), shine=0, specular=RGB(255, 255, 255), transparency=0})

# ---- group: EXTRUSION OF RESIDENCE / MOVE FOOTPRINTS OVER COMMERCIAL VOLUMES
pt = ConstructPoint(XCoordinate=0, YCoordinate=0, ZCoordinate=height_of_commercial_spaces)
move = Move(Geometry=split_2.ListA, Motion=pt)  # -> Geometry, Transform

# ---- group: EXTRUSION OF RESIDENCE
area_3 = Area(Geometry=[move.Geometry, split_2.ListB])  # -> Area, Centroid

# ---- group: EXTRUSION OF RESIDENCE / Sum of list values
python_2 = GhPythonScript(x=area_3.Area)  # -> out, a; inputs x: list
# ---------- python_2: Python ----------
__author__ = "Gabo"
__version__ = "2019.02.01"

import rhinoscriptsyntax as rs
a = 0
for i in x:
    a = a+i
# ---------- end python_2 ----------

# ---- group: EXTRUSION OF RESIDENCE / HEIGHT OF EXTRUSION
division = Division(A=multiplication, B=python_2.a)

# ---- group: EXTRUSION OF RESIDENCE (continued)
Z_2 = UnitZ(Factor=division)
height_of_residential_buildings = Panel(division)

# ---- group: EXTRUSION OF RESIDENCE / Residence extrusion
extr_2 = Extrude(Base=[move.Geometry, split_2.ListB], Direction=Z_2)

# ----
preview_2 = CustomPreview(
    Geometry=extr_2,
    Material={diffuse=RGB(195, 191, 147), emission=RGB(0, 0, 0), shine=0, specular=RGB(255, 255, 255), transparency=0})
